# Grasshopper definition n8n_in_gh.gh (Grasshopper 1.0.7)

# n8n + regularAPI
panel = Panel("https://run8n.xyz/webhook/param_generator")
# n8n + LLM Agent
panel_2 = Panel("https://run8n.xyz/webhook/ai_agent")
panel_3 = Panel("Naja the central area, deserves its own attracctor point... add it an make that extra high. Ensure the overall concept is maintained")

# ---- group: capture viewport
trigger = BooleanToggle(False)
trigger_2 = BooleanToggle(True)
captureviewport = GhPythonScript(viewport_name="Perspective", trigger=trigger, save_to_disk=trigger_2)  # -> bitmap, file_path
# ---------- captureviewport: Python ----------
"""Provides a scripting component.
    Inputs:
        viewport_name: Name of the viewport to capture (empty or "active" for active view)
        trigger: Optional trigger for the component
        save_to_disk: Boolean to determine if image should be saved to disk
    Output:
        bitmap: The captured viewport as a bitmap
        file_path: Path to the saved image file (if save_to_disk is True)"""

__author__ = "Serjoscha Duering"
__version__ = "2024.04.14"

import rhinoscriptsyntax as rs
import Grasshopper.DataTree as tree
import Grasshopper.Kernel.Data.GH_Path as ghpath
import Rhino
import scriptcontext as sc
import System.Drawing as sd
import System
import System.IO as sio
import os

def capture_viewport_to_bitmap(viewport_name=None):
    # Get the view either by name or active view
    view = None
    
    # Check if viewport_name is None, empty, or some version of "active"
    if viewport_name is None or viewport_name.strip() == "" or viewport_name.strip().lower() == "active":
        # Use the active view
        view = sc.doc.Views.ActiveView
        print("Using active viewport")
    else:
        # Try to find the view by name
        for v in sc.doc.Views:
            if v.ActiveViewport.Name.ToLower() == viewport_name.ToLower():
                view = v
                break
        
        if view is None:
            raise ValueError("No viewport found with name: " + viewport_name + 
                            "\nAvailable viewports: " + ", ".join([v.ActiveViewport.Name for v in sc.doc.Views]))
    
    # Ensure there's a view to work with
    if not view:
        raise ValueError("No view available.")
    
    # Make sure the view is updated
    sc.doc.Views.Redraw()
    
    # Get the size of the view
    size = view.Size
    
    # Capture the viewport directly to bitmap
    bitmap = view.CaptureToBitmap(sd.Size(size.Width, size.Height))
    
    if bitmap:
        return bitmap
    else:
        raise RuntimeError("Bitmap capture returned null")

def save_bitmap_to_file(bitmap, component_instance_guid):
    # Get the directory where the current GH file is located
    gh_doc = ghenv.Component.OnPingDocument()
    
    if gh_doc.IsFilePathDefined:
        # GH file has been saved, use its directory
        gh_file_path = gh_doc.FilePath
        directory = sio.Path.GetDirectoryName(gh_file_path)
    else:
        # GH file hasn't been saved yet
        raise ValueError("Grasshopper file has not been saved. Cannot determine directory.")
    
    # Create a filename based on the component's GUID
    filename = "temp_" + str(component_instance_guid).replace("-", "") + ".png"
    file_path = sio.Path.Combine(directory, filename)
    
    # Save the bitmap to disk
    bitmap.Save(file_path, System.Drawing.Imaging.ImageFormat.Png)
    
    print("Image saved to: " + file_path)
    return file_path

# Get the component's instance GUID
component_guid = ghenv.Component.InstanceGuid

# Capture the viewport
bitmap = capture_viewport_to_bitmap(viewport_name)
print("Viewport captured as bitmap.")
print("Image dimensions: " + str(bitmap.Width) + "x" + str(bitmap.Height))

# Save to disk if requested
file_path = None
if save_to_disk:
    file_path = save_bitmap_to_file(bitmap, component_guid)

# Set outputs
a = bitmap  # First output: bitmap
b = file_path  # Second output: file path
# ---------- end captureviewport ----------

trigger_3 = BooleanToggle(True)
trigger_4 = BooleanToggle(True)
captureviewport_2 = GhPythonScript(viewport_name="Top", trigger=trigger_3, save_to_disk=trigger_4)  # -> bitmap, file_path; same code as captureviewport

# ---- group: from file
trigger_5 = BooleanToggle(False)
file_path = FilePath("C:\Users\Serjoscha Duering\OneDrive - REHUB digitale Planer GmbH\Dokumente\01_ProjectsOD\Experiments\metaGH\gptVisiont.PNG")
load_image = GhPythonScript(trigger=trigger_5, file_path=file_path)  # -> loaded_bitmap
# ---------- load_image: Python ----------
__author__ = "Serjoscha Duering"
__version__ = "2024.02.24"

import rhinoscriptsyntax as rs
import Grasshopper.DataTree as tree
import Grasshopper.Kernel.Data.GH_Path as ghpath


import System
from System.Drawing import Bitmap, Graphics
from System.Windows.Forms import Screen

__author__ = "Serjoscha Duering"
__version__ = "2024.02.24"

import System
from System.Drawing import Bitmap

def load_image_from_file(filepath):
    # Load the image from the specified file path
    try:
        image = Bitmap(filepath)
        return image
    except Exception as e:
        print("Error loading image: " + str(e))
        return None


loaded_bitmap = load_image_from_file(file_path)
# ---------- end load_image ----------

# ---- group: capture viewport
trigger_6 = BooleanToggle(True)
captureviewport_3 = GhPythonScript(trigger=trigger_6)  # -> bitmap
# ---------- captureviewport_3: Python ----------
__author__ = "Serjoscha Duering"
__version__ = "2024.02.24"

import rhinoscriptsyntax as rs
import Grasshopper.DataTree as tree
import Grasshopper.Kernel.Data.GH_Path as ghpath
import Rhino
import scriptcontext as sc
import System.Drawing as sd
import System.IO as sio
import time

def capture_viewport_to_bitmap():
    tm = str(time.time())
    
    # Mac uses different temp directory approach
    # Use System.IO for better cross-platform compatibility
    temp_dir = sio.Path.GetTempPath()
    tmp_filename = "temp_vp" + tm + ".png"
    temp_path = sio.Path.Combine(temp_dir, tmp_filename)
    
    # Get the active Rhino document's active view
    view = sc.doc.Views.ActiveView
    
    # Ensure there's an active view to work with
    if not view:
        print("No active view found.")
        return None
        
    try:
        # Set the view to rendered mode (if not already)
        # Note: On Mac, finding display modes can sometimes be different
        try:
            view.ActiveViewport.DisplayMode = Rhino.Display.DisplayModeDescription.FindByName("Rendered")
        except:
            # Fallback to another common display mode if "Rendered" isn't available
            display_modes = Rhino.Display.DisplayModeDescription.GetDisplayModes()
            if display_modes and len(display_modes) > 0:
                view.ActiveViewport.DisplayMode = display_modes[0]
        
        # Make sure the view is updated
        sc.doc.Views.Redraw()
        
        # Get the size of the view
        size = view.Size
        
        # Capture the viewport - with error handling
        bitmap = view.CaptureToBitmap(sd.Size(size.Width, size.Height))
        if bitmap:
            # Save the bitmap to file
            bitmap.Save(temp_path)
            
            # Load the image from the file into a System.Drawing.Bitmap
            result_bitmap = sd.Bitmap(temp_path)
            
            # Clean up the temporary file
            try:
                if sio.File.Exists(temp_path):
                    sio.File.Delete(temp_path)
            except:
                pass
                
            return result_bitmap
        else:
            print("Bitmap capture returned null")
            return None
            
    except Exception as e:
        print("Error capturing viewport: " + str(e))
        return None

# Example usage
bitmap = capture_viewport_to_bitmap()
if bitmap:
    print("Viewport captured as bitmap.")
    print("Image dimensions: " + str(bitmap.Width) + "x" + str(bitmap.Height))
    a = bitmap  # Set the output
else:
    print("Failed to capture viewport.")
    a = None
# ---------- end captureviewport_3 ----------

# ---- group: take screenshot
# Image Utils
trigger_7 = BooleanToggle(True)
screencap = GhPythonScript(trigger=trigger_7)  # -> screenshot_out
# ---------- screencap: Python ----------
__author__ = "Serjoscha Duering"
__version__ = "2024.02.24"

import rhinoscriptsyntax as rs
import Grasshopper.DataTree as tree
import Grasshopper.Kernel.Data.GH_Path as ghpath


import System
from System.Drawing import Bitmap, Graphics
from System.Windows.Forms import Screen

def capture_screen():
    # Get the primary screen's bounds, which gives us the screen's width and height
    screen_bounds = Screen.PrimaryScreen.Bounds
    
    # Create a bitmap of the same size as the screen
    screenshot = Bitmap(screen_bounds.Width, screen_bounds.Height)
    
    # Create a graphics object from the bitmap
    graphics = Graphics.FromImage(screenshot)
    
    # Copy the screen's content into our bitmap
    graphics.CopyFromScreen(screen_bounds.X, screen_bounds.Y, 0, 0, screen_bounds.Size)
    
    # Clean up the graphics object
    graphics.Dispose()
    
    return screenshot

# Capture the screen
screenshot_bitmap = capture_screen()#

screenshot_out = screenshot_bitmap
# ---------- end screencap ----------

# ----
n8n = GhPythonScript(n8n_url=panel, data="a wide tower, 30m high, with a massive base ")  # -> out, response; inputs images: list
# ---------- n8n: Python ----------
"""Provides a scripting component for connecting to n8n via webhook.
    Inputs:
        prompt: Text prompt to send (str)
        images: List of bitmap images to send
        n8n_url: URL of the n8n webhook (str)
        auth_token: Optional authentication token (str)
        session_id: Identifier for the session (str)
    Output:
        response: The response from the webhook
        status: Status message of the request"""

__author__ = "Serjoscha Duering"
__version__ = "2025.04.14"

import rhinoscriptsyntax as rs
import scriptcontext as sc
import Grasshopper as gh
import Rhino.Geometry as rg
import System
import json
import clr
from System.Drawing.Drawing2D import InterpolationMode
from System.Drawing import Bitmap, Graphics, Rectangle, Size
from System.Net import WebRequest, WebException
from System.Text import Encoding
from System.Convert import ToBase64String
from System.IO import MemoryStream

# Set default session_id if not provided
if not session_id:
    # Get the name of the current Grasshopper document
    session_id = sc.doc.Name if sc.doc.Name else "GrasshopperSession"

# Prepare image processing functions
def resize_image(bitmap_image, max_width=1024):
    """Resize an image while maintaining aspect ratio"""
    if bitmap_image is None:
        return None

    original_width, original_height = bitmap_image.Width, bitmap_image.Height
    if original_width > max_width:
        ratio = max_width / float(original_width)
        new_height = int(original_height * ratio)
        new_size = Size(max_width, new_height)

        # Resize image
        resized_image = Bitmap(new_size.Width, new_size.Height)
        with Graphics.FromImage(resized_image) as graphics:
            graphics.InterpolationMode = InterpolationMode.HighQualityBicubic
            graphics.DrawImage(bitmap_image, 0, 0, new_size.Width, new_size.Height)
        return resized_image
    else:
        return bitmap_image

def image_to_base64(bitmap_image, max_width=1024):
    """Convert a bitmap image to base64 string"""
    if bitmap_image is None:
        return None
        
    resized_image = resize_image(bitmap_image, max_width)
    with MemoryStream() as ms:
        resized_image.Save(ms, System.Drawing.Imaging.ImageFormat.Png)
        base64_image = ToBase64String(ms.ToArray())
        # Add the data URI prefix for PNG
        return "data:image/png;base64," + base64_image

# Convert all images to base64
image_data = []
if images:
    for img in images:
        base64_img = image_to_base64(img)
        if base64_img:
            image_data.append(base64_img)

# Prepare the payload
payload = {
    "data": data,
    "images": image_data,
    "session_id": session_id
}

# Send request to n8n webhook
try:
    # Create the web request
    request = WebRequest.Create(n8n_url)
    request.Method = "POST"
    request.ContentType = "application/json"
    
    # Add authentication if provided
    if auth_token:
        # Use the 'Authentication' header with the token as password
        request.Headers.Add("Authorization", auth_token)
    
    # Convert payload to JSON and then to bytes
    json_data = json.dumps(payload)
    bytes_data = Encoding.UTF8.GetBytes(json_data)
    
    # Set content length and write data to request stream
    request.ContentLength = bytes_data.Length
    request_stream = request.GetRequestStream()
    request_stream.Write(bytes_data, 0, bytes_data.Length)
    request_stream.Close()
    
    # Get response
    response_obj = request.GetResponse()
    response_stream = response_obj.GetResponseStream()
    reader = System.IO.StreamReader(response_stream)
    response_text = reader.ReadToEnd()
    reader.Close()
    response_stream.Close()
    response_obj.Close()
    
    # Parse response
    response = response_text
    status = "Success"
    
except WebException as e:
    if e.Response is not None:
        error_stream = e.Response.GetResponseStream()
        error_reader = System.IO.StreamReader(error_stream)
        error_text = error_reader.ReadToEnd()
        error_reader.Close()
        error_stream.Close()
        response = error_text
        status = "Error: " + str(e.Status)
    else:
        response = None
        status = "Error: " + str(e)
except Exception as e:
    response = None
    status = "Error: " + str(e)
# ---------- end n8n ----------
n8n_2 = GhPythonScript(
    n8n_url=panel_2,
    auth_token="MySecretN8NKey",
    session_id="DesignD",
    data=panel_3,
    images=[captureviewport.bitmap, captureviewport_2.bitmap])  # -> out, response; inputs images: list; same code as n8n
panel_4 = Panel(n8n.response)
# n8n wrapper
# explaination: n8n_url
# the url you get from the n8n webhook component
# 
# auth_token
# optional in case you added basic authentification to your n8n webhook
# 
# session_id
# identifyer you can use e.g. to setup a persistant memory when using AI Agents
# 
# data
# the payload, e.g. json string or a prompt
# 
# images
# optional images as bitmap, they will be sent b64 encoded
n8n_3 = GhPythonScript()  # -> out, response; inputs images: list; same code as n8n
point = Point(<point referenced from the Rhino model>)
number_slider = Slider(20, range=0..30)
number_slider_2 = Slider(30, range=0..30)
number_slider_3 = Slider(55, range=1..100)
number_slider_4 = Slider(2.135, range=0..4)
ghpython_script = GhPythonScript(json_input=n8n_2.response)  # -> output, cor_x, cor_y, cor_z, uuid_list, out
#   port json_input: JSON string containing keys x, y, z, uuid with lists of numbers or strings
# ---------- ghpython_script: Python ----------
import json

# Initialize output variables
cor_x = []
cor_y = []
cor_z = []
uuid_list = []
out = ""

try:
    # Parse the JSON input
    data = json.loads(json_input)["output"]
    
    # Extract lists from the parsed data
    cor_x = data.get('x', [])
    cor_y = data.get('y', [])
    cor_z = data.get('z', [])
    uuid_list = data.get('id', [])
except Exception as e:
    # Capture any exceptions and store in the output
    out = "Error parsing JSON: " + str(e)
# ---------- end ghpython_script ----------
panel_5 = Panel(n8n_2.response)
ghpython_script_2 = GhPythonScript(x=n8n.response)  # -> output, XSize, YSize, Height, Rotation
#   port x: JSON formatted string containing input data
# ---------- ghpython_script_2: Python ----------
import json

# Parse the input JSON string
print x
input_data = json.loads(x)["output"]
print input_data.keys()



# Extract necessary values from the nested dictionary
rotation = input_data.get('Rotation', None)
height = input_data.get('Height', None)

# Initialize XSize and YSize as None since we don't have enough information
x_size = input_data.get('Density', None)
y_size = input_data.get('SomethingImportant', None)

# Assign outputs
XSize = x_size
YSize = y_size
Height = height
Rotation = rotation
# ---------- end ghpython_script_2 ----------
# n8n workflow example code
n8n_code_copy_paste_it_into_the_n8n_canv = Panel("""{
  "nodes": [
    {
      "parameters": {
        "promptType": "define",
        "text": "={{ $('Webhook1').item.json.body.data }}",
        "hasOutputParser": true,
        "options": {
          "systemMessage": "You are an conceptual urban designer. Your shape the urban design according to the user requirements that come in in the form of text prompt or reference image. \n\nThe design space:\nwe have a simple massing model. The only thing you can change is the height distribution of the building volumes by placeing, shifting, adding , removing attractor points. The z-value determines the height of a poinnt whih is mapped to the buildings heights nearby. There is an inverse distance function that determine the impact of each attractor point on building heights - points closer to a building have larger impact. \n\nyou can create interesting height patterns by strategically adding multiple of these height points.\n\nTo understand the scene you will be show a top down image and a perspective image for each run. placed points are indicated by a black dot and a red annotation showing their ID. there is also a 2D Grid with annotations that help you to generate cordinates for new or existing points.\n\nMoreover you can use this conservation memory, to look up the generated coordinates of points  from the previous iteration.\n\n\nAlways start by assessing the user request, reason about a generell strategy to achieve it and then iterate in small steps.\n\nAlways reply in this format:\n{\n    \"message\":\"\",\n\t\"x\": [],\n\t\"y\": [],\n    \"z\":[],\n    \"id\":[]\n}\n\nyou can use the message key for reasoning. and strategizing.",
          "passthroughBinaryImages": true
        }
      },
      "type": "@n8n/n8n-nodes-langchain.agent",
      "typeVersion": 1.8,
      "position": [
        -40,
        880
      ],
      "id": "02f50a3a-d333-4536-9494-c46a59be54ee",
      "name": "AI Agent"
    },
    {
      "parameters": {
        "httpMethod": "POST",
        "path": "ai_agent",
        "authentication": "headerAuth",
        "responseMode": "responseNode",
        "options": {}
      },
      "type": "n8n-nodes-base.webhook",
      "typeVersion": 2,
      "position": [
        -460,
        880
      ],
      "id": "23309b29-9b78-48b8-b3b1-c840c3c214b2",
      "name": "Webhook1",
      "webhookId": "e2e2caf8-0200-451a-b35b-31561d466d2b",
      "credentials": {
        "httpHeaderAuth": {
          "id": "nz2ngCmnJwFcx0l6",
          "name": "grasshopper_n8n"
        }
      }
    },
    {
      "parameters": {
        "options": {}
      },
      "type": "n8n-nodes-base.respondToWebhook",
      "typeVersion": 1.1,
      "position": [
        380,
        880
      ],
      "id": "d2faec36-d547-438e-b564-81a3b12abf48",
      "name": "Respond to Webhook1"
    },
    {
      "parameters": {
        "model": {
          "__rl": true,
          "value": "gpt-4.1-mini",
          "mode": "list",
          "cachedResultName": "gpt-4.1-mini"
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""")  # "n8n code - copy paste it into the n8n canvas"
list_length = ListLength(List=ghpython_script.cor_z)
construct_point = ConstructPoint(XCoordinate=ghpython_script.cor_x, YCoordinate=ghpython_script.cor_y, ZCoordinate=ghpython_script.cor_z)
series = Series(Start=0, Step=1, Count=list_length)

rectangle = Rectangle(Plane=point, XSize=ghpython_script_2.XSize, YSize=ghpython_script_2.YSize, Radius=0)  # -> Rectangle, Length
unit_z = UnitZ(Factor=ghpython_script_2.Height)
surface = Surface(rectangle.Rectangle)
area = Area(Geometry=rectangle.Rectangle)  # -> Area, Centroid
extrude = Extrude(Base=surface, Direction=unit_z)
rotate = Rotate(Geometry=extrude, Angle=ghpython_script_2.Rotation, Plane=area.Centroid)  # -> Geometry, Transform
custom_preview = CustomPreview(
    Geometry=rotate.Geometry,
    Material={diffuse=RGB(228, 178, 227), emission=RGB(68, 53, 68), shine=0.5, specular=RGB(255, 254, 254), transparency=0})

uuid = Data(series)
data = Data(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)

surface_2 = Surface(data)
cluster = Cluster(curves_b=surface_2, geometry=surface_2, count=Slider(7, range=1..100), data=construct_point)  # -> extrusion, geometry_2
custom_preview_2 = CustomPreview(Geometry=cluster.extrusion, Material=ColourSwatch(SwatchColor=RGB(245, 223, 223)))

# ---- group: Annotation
bounding_box = BoundingBox(Content=data, Plane=PlaneXY(0, 0, 0))  # -> Box, Box_2
box_corners = BoxCorners(Box=bounding_box.Box)  # -> CornerA, CornerB, CornerC, CornerD, CornerE, CornerF, CornerG, CornerH
number_slider_5 = Slider(10, range=0..100)
data_2 = Data(box_corners.CornerA)
square = Square(Plane=data_2, Size=Slider(58, range=0..100), ExtentX=number_slider_5, ExtentY=number_slider_5)  # -> simplify(Cells), simplify(Points)
flip_matrix = FlipMatrix(Data=square.Points)
tree_branch = TreeBranch(Tree=square.Points, Path=Slider(0, range=0..100), MaintainPaths=True)
tree_branch_2 = TreeBranch(Tree=flip_matrix, Path=Slider(0, range=0..100), MaintainPaths=True)
unit_x = UnitX(Factor=Slider(-30, range=-40..20))
unit_y = UnitY(Factor=Slider(-30, range=-40..20))
move = Move(Geometry=tree_branch, Motion=unit_x)  # -> Geometry, Transform
move_2 = Move(Geometry=tree_branch_2, Motion=unit_y)  # -> Geometry, Transform
deconstruct = Deconstruct(Point=move.Geometry)  # -> XComponent, YComponent, ZComponent
deconstruct_2 = Deconstruct(Point=move_2.Geometry)  # -> XComponent, YComponent, ZComponent
integer = Integer(deconstruct.YComponent)
integer_2 = Integer(deconstruct_2.XComponent)
text_tag = TextTag(Location=move.Geometry, Text=integer)
text_tag_2 = TextTag(Location=move_2.Geometry, Text=integer_2)

# ---- group: height points
data_3 = Data(construct_point)
unit_z_2 = UnitZ(Factor=Slider(10, range=0..10))
move_3 = Move(Geometry=data_3, Motion=unit_z_2)  # -> Geometry, Transform
line = Line(StartPoint=cluster.geometry_2, EndPoint=data_3)
text_tag_3 = TextTag(Location=move_3.Geometry, Text=uuid, Colour=ColourSwatch(SwatchColor=RGB(255, 0, 0)))
dot_display = DotDisplay(Point=data_3, Colour=RGB(0, 0, 0), Size=Slider(12, range=0..20))

# ---- group: async server communicating with VibeCode webapp
# gh vibe client
trigger_8 = BooleanToggle(True)
vibecode_gh_server_running = GhPythonScript(RunServer=trigger_8)  # -> A
# ---------- vibecode_gh_server_running: Python ----------
# IronPython 2.7
import scriptcontext as sc
import clr
import socket
import threading
import json
import System
from System import Guid
from System.Drawing import RectangleF
import traceback # To log detailed errors
import time # Ensure time is imported
import re # Add import for regular expressions
import Rhino # <--- ADD THIS LINE

# Add References
clr.AddReference("System")
clr.AddReference("System.Drawing")
clr.AddReference("Grasshopper")

# Imports for Grasshopper types
import Grasshopper
import Grasshopper as gh
from Grasshopper.Kernel import GH_ParamAccess, IGH_Param
from Grasshopper.Kernel.Parameters import (
    Param_GenericObject, Param_String, Param_Number,
    Param_Integer, Param_Boolean, Param_Guid, Param_Point,
    Param_Vector, Param_Curve, Param_Surface, Param_Brep, Param_Mesh
)
# Import Action for Rhino.RhinoApp.InvokeOnUiThread
from System import Action

# --- Constants ---
HOST = "127.0.0.1"
PORT = 9998 # Use port 9998
COMPONENT_NICKNAME = "VibeCode GH Server" # Set a nickname for the component running this script

# --- Script Context Sticky Management ---
# Use scriptcontext.sticky as a persistent dictionary.
if "server_running" not in sc.sticky:
    sc.sticky["server_running"] = False
if "server_thread" not in sc.sticky:
    sc.sticky["server_thread"] = None
if "last_error" not in sc.sticky:
    sc.sticky["last_error"] = None

# --- JSON Encoding ---
class GHEncoder(json.JSONEncoder):
    """Custom JSON encoder for basic types, prevents errors with complex GH types."""
    def default(self, obj):
        if isinstance(obj, System.Guid):
            return str(obj)
        # Add other simple type conversions if needed, but avoid complex geometry
        # For most communication, we'll stick to strings, numbers, bools, lists, dicts
        try:
            return json.JSONEncoder.default(self, obj)
        except TypeError:
            return repr(obj) # Fallback to representation string

# --- Grasshopper Interaction Functions ---

def find_script_components(doc):
    """Finds all script components in the document."""
    script_components = []
    if not doc:
        return script_components
    for obj in doc.Objects:
        # Check if it's a component and likely a script component
        # (Checking for 'Code' attribute is a good indicator for GHPython)
        if isinstance(obj, Grasshopper.Kernel.IGH_Component) and hasattr(obj, "Code"):
             script_components.append(obj)
    return script_components

def get_selected_script_component_details():
    """
    Checks the current selection in Grasshopper.
    If exactly one script component is selected, returns its details.
    Otherwise, returns None or an indicator status.
    """
    doc = ghenv.Component.OnPingDocument()
    if not doc:
        return {"status": "error", "result": "No active Grasshopper document"}

    selected_script_components = []
    for obj in doc.Objects:
        if hasattr(obj, "Attributes") and obj.Attributes.Selected:
            # Check if it's a script component (e.g., GHPython)
            if isinstance(obj, Grasshopper.Kernel.IGH_Component) and hasattr(obj, "Code"):
                selected_script_components.append(obj)

    if len(selected_script_components) == 1:
        comp = selected_script_components[0]
        details = {
            "instance_guid": str(comp.InstanceGuid),
            "code": comp.Code if hasattr(comp, "Code") else "# Code attribute not found",
            "description": comp.Description,
            "param_definitions": format_params_for_webapp(comp)
        }
        return {"status": "success", "result": details}
    elif len(selected_script_components) == 0:
        return {"status": "none_selected", "result": "No script component selected"}
    else:
        return {"status": "multiple_selected", "result": "Multiple script components selected"}

def format_params_for_webapp(component):
    """Formats component parameters into the structure expected by the web app."""
    param_definitions = []
    if not hasattr(component, "Params"):
        return param_definitions

    # Process Inputs
    if hasattr(component.Params, "Input"):
        for p in component.Params.Input:
            param_info = {
                "type": "input",
                "name": p.NickName or p.Name, # Prefer NickName if available
                "description": p.Description,
                "access": get_access_string(p.Access),
                "typehint": get_typehint_string(p),
                "optional": p.Optional
            }
            param_definitions.append(param_info)

    # Process Outputs
    if hasattr(component.Params, "Output"):
        for p in component.Params.Output:
             # Outputs are simpler in the webapp's view
            param_info = {
                "type": "output",
                "name": p.NickName or p.Name,
                "description": p.Description
            }
            param_definitions.append(param_info)

    return param_definitions

def get_access_string(gh_param_access):
    """Converts GH_ParamAccess enum to string."""
    if gh_param_access == GH_ParamAccess.item:
        return "item"
    elif gh_param_access == GH_ParamAccess.tree:
        return "tree"
    else: # Default to list
        return "list"

def get_typehint_string(param):
    """Attempts to guess a simple typehint string from the parameter type."""
    # This provides a basic mapping. More specific hints might require checking param.TypeHint if available and reliable.
    if isinstance(param, Param_String): return "str"
    if isinstance(param, Param_Integer): return "int"
    if isinstance(param, Param_Number): return "float"
    if isinstance(param, Param_Boolean): return "bool"
    if isinstance(param, Param_Guid): return "guid"
    if isinstance(param, Param_Point): return "point"
    if isinstance(param, Param_Vector): return "vector"
    if isinstance(param, Param_Curve): return "curve"
    if isinstance(param, Param_Surface): return "surface"
    if isinstance(param, Param_Brep): return "brep"
    if isinstance(param, Param_Mesh): return "mesh"
    # Default for Param_GenericObject or others
    return "generic"

def get_access_enum(access_str):
    """Converts string ('item', 'list', 'tree') to GH_ParamAccess enum."""
    s = str(access_str).lower()
    if s == "item":
        return GH_ParamAccess.item
    elif s == "tree":
        return GH_ParamAccess.tree
    # Default to list for unknown or missing values
    return GH_ParamAccess.list

def create_gh_input_param(param_def):
    """Creates a Grasshopper input parameter from a definition dictionary."""
    name = param_def.get("name", "input")
    hint = param_def.get("typehint", "generic").lower()
    description = param_def.get("description", "Input parameter")
    access = get_access_enum(param_def.get("access", "list"))
    optional = param_def.get("optional", True)

    # Choose parameter type based on hint
    if hint == "str": param = Param_String()
    elif hint == "int": param = Param_Integer()
    elif hint == "float": param = Param_Number()
    elif hint == "bool": param = Param_Boolean()
    elif hint == "guid": param = Param_Guid()
    elif hint == "point": param = Param_Point()
    elif hint == "vector": param = Param_Vector()
    elif hint == "curve": param = Param_Curve()
    elif hint == "surface": param = Param_Surface()
    elif hint == "brep": param = Param_Brep()
    elif hint == "mesh": param = Param_Mesh()
    else: param = Param_GenericObject() # Default

    param.Name = name
    param.NickName = name
    param.Description = description
    param.Access = access
    param.Optional = optional
    # We don't set param.TypeHint explicitly here to allow users
    # to still change the type via the context menu if needed.
    # The component's behavior relies on the actual parameter *type*.

    return param

def create_gh_output_param(param_def):
    """Creates a Grasshopper output parameter from a definition dictionary."""
    name = param_def.get("name", "output")
    description = param_def.get("description", "Output parameter")

    # Outputs are typically generic unless specific typing is strictly needed
    param = Param_GenericObject()
    param.Name = name
    param.NickName = name
    param.Description = description

    return param

def update_script_component_on_ui_thread(instance_guid_str, code, description, param_definitions):
    """
    Wrapper function to perform the component update on the UI thread.
    Handles finding the component, updating code, description, parameters,
    AND attempts to restore wire connections based on NickName.
    Uses a dummy parameter strategy for robust parameter updates.
    Returns a dictionary indicating success or failure.
    """
    result = {"status": "error", "result": "Update failed"} # Default result
    comp = None
    canvas = None
    doc = None # Make doc accessible in finally

    # --- Storage for old connections ---
    old_input_connections = {} # { nickName: [source_guid1, source_guid2, ...], ... }
    old_output_connections = {} # { nickName: [recipient_guid1, recipient_guid2, ...], ... }
    connection_restore_log = [] # Log messages about connection restoration

    try:
        doc = ghenv.Component.OnPingDocument()
        if not doc:
            return {"status": "error", "result": "No active Grasshopper document"}

        target_instance_guid = Guid.Parse(instance_guid_str) # Assuming valid GUID format based on previous checks
        comp = doc.FindObject(target_instance_guid, False)
        if not comp or not (isinstance(comp, Grasshopper.Kernel.IGH_Component) and hasattr(comp, "Code")):
             return {"status": "error", "result": "Target component (GUID: {}) not found or not a script component.".format(instance_guid_str)}

        # === Step 0: Record Existing Connections BEFORE modifications ===
        try:
            if hasattr(comp.Params, "Input"):
                for p_in in list(comp.Params.Input): # Iterate copy
                    if p_in.NickName and p_in.Sources: # Check if sources exist
                        old_input_connections[p_in.NickName] = [source.InstanceGuid for source in p_in.Sources if source] # Store source GUIDs

            if hasattr(comp.Params, "Output"):
                 for p_out in list(comp.Params.Output): # Iterate copy
                     if p_out.NickName and p_out.Recipients: # Check if recipients exist
                         old_output_connections[p_out.NickName] = [recipient.InstanceGuid for recipient in p_out.Recipients if recipient] # Store recipient GUIDs
            connection_restore_log.append("Recorded {} input and {} output connection sets.".format(len(old_input_connections), len(old_output_connections)))
        except Exception as e:
            connection_restore_log.append("Warning: Error recording connections: {}".format(e))
            old_input_connections = {} # Clear on error to prevent issues later
            old_output_connections = {}

        # --- Perform Updates ---
        code_updated = False
        params_updated = False
        description_updated = False

        canvas = gh.Instances.ActiveCanvas
        if canvas: canvas.Document.Enabled = False

        # Lists to store the *new* parameter objects created
        new_input_params = []
        new_output_params = []

        try:
            # === Step 1: Update Parameters ===
            if param_definitions is not None:
                dummy_input = None
                dummy_output = None
                try:
                    # Dummy Parameter Strategy (as before)
                    dummy_input_def = {"name": "__dummy_in__", "description": "Temp"}
                    dummy_output_def = {"name": "__dummy_out__", "description": "Temp"}
                    dummy_input = create_gh_input_param(dummy_input_def)
                    dummy_output = create_gh_output_param(dummy_output_def)
                    comp.Params.RegisterInputParam(dummy_input)
                    comp.Params.RegisterOutputParam(dummy_output)

                    inputs_to_remove = [p for p in comp.Params.Input if p.InstanceGuid != dummy_input.InstanceGuid]
                    outputs_to_remove = [p for p in comp.Params.Output if p.InstanceGuid != dummy_output.InstanceGuid]
                    for p in inputs_to_remove: comp.Params.UnregisterInputParameter(p)
                    for p in outputs_to_remove: comp.Params.UnregisterOutputParameter(p)

                    # Add New & Store References
                    for p_def in param_definitions:
                        param_type = p_def.get("type", "").lower()
                        if param_type == "input":
                            new_param = create_gh_input_param(p_def)
                            comp.Params.RegisterInputParam(new_param)
                            new_input_params.append(new_param) # Store new input param obj
                        elif param_type == "output":
                            new_param = create_gh_output_param(p_def)
                            comp.Params.RegisterOutputParam(new_param)
                            new_output_params.append(new_param) # Store new output param obj

                    # Ensure Default Output & Store Reference
                    current_output_names = [p.Name for p in comp.Params.Output]
                    if "output" not in current_output_names and "__dummy_out__" not in current_output_names:
                         default_out = create_gh_output_param({"name": "output", "description": "Default output"})
                         comp.Params.RegisterOutputParam(default_out)
                         new_output_params.append(default_out) # Store new default output obj

                    # Remove Dummies
                    if dummy_input: comp.Params.UnregisterInputParameter(dummy_input)
                    if dummy_output: comp.Params.UnregisterOutputParameter(dummy_output)

                    params_updated = True
                except Exception as e:
                    sc.sticky["last_error"] = "Parameter update failed: {}".format(e)
                    try:
                        if dummy_input and dummy_input in comp.Params.Input: comp.Params.UnregisterInputParameter(dummy_input)
                        if dummy_output and dummy_output in comp.Params.Output: comp.Params.UnregisterOutputParameter(dummy_output)
                    except: pass

            # === Step 2: Restore Connections ===
            if params_updated and doc: # Only if params were changed and doc exists
                connection_restore_log.append("Attempting connection restoration...")
                # Restore Input Connections
                for new_p_in in new_input_params:
                    if new_p_in.NickName in old_input_connections:
                        source_guids = old_input_connections[new_p_in.NickName]
                        sources_found = 0
                        for source_guid in source_guids:
                            source_param = doc.FindObject(source_guid, False)
                            if isinstance(source_param, IGH_Param): # Check if it's a valid parameter
                                try:
                                    new_p_in.AddSource(source_param)
                                    sources_found += 1
                                except Exception as conn_e:
                                     connection_restore_log.append(" Error connecting Input '{}' to Source {}: {}".format(new_p_in.NickName, source_guid, conn_e))
                        if sources_found > 0:
                             connection_restore_log.append(" Restored {} source(s) for Input '{}'".format(sources_found, new_p_in.NickName))

                # Restore Output Connections
                for new_p_out in new_output_params:
                    if new_p_out.NickName in old_output_connections:
                        recipient_guids = old_output_connections[new_p_out.NickName]
                        recipients_found = 0
                        for recipient_guid in recipient_guids:
                            recipient_param = doc.FindObject(recipient_guid, False)
                            if isinstance(recipient_param, IGH_Param): # Check if it's a valid parameter
                                try:
                                    # Connect FROM new_p_out TO recipient_param
                                    recipient_param.AddSource(new_p_out)
                                    recipients_found += 1
                                except Exception as conn_e:
                                    connection_restore_log.append(" Error connecting Output '{}' to Recipient {}: {}".format(new_p_out.NickName, recipient_guid, conn_e))
                        if recipients_found > 0:
                             connection_restore_log.append(" Restored {} recipient(s) for Output '{}'".format(recipients_found, new_p_out.NickName))
                sc.sticky["connection_log"] = "\n".join(connection_restore_log) # Store log

            # === Step 3: Update Code / Description (PRINT REMOVED) ===
            if code is not None:
                try:
                    comp.Code = str(code)
                    code_updated = True
                except Exception as e:
                    sc.sticky["last_error"] = "Code update failed: {}".format(e)
            if description is not None:
                try:
                    comp.Description = str(description)
                    description_updated = True
                except Exception as e:
                    sc.sticky["last_error"] = "Description update failed: {}".format(e)

            # === Step 4: Finalize layout and solution expiry ===
            if params_updated: # Only call if params actually changed
                comp.Params.OnParametersChanged()
            if hasattr(comp, "Attributes"): comp.Attributes.ExpireLayout()
            comp.ExpireSolution(True)

            result = {
                "status": "success",
                "result": {
                    "code_updated": code_updated,
                    "params_updated": params_updated,
                    "description_updated": description_updated,
                    "component_type": type(comp).__name__,
                    "connection_log": connection_restore_log # Include log in result
                }
            }

        except Exception as e:
            result = {"status": "error", "result": "Error during component update process: {}".format(e)}
            sc.sticky["last_error"] = result["result"]
        finally:
            # Re-enable canvas, refresh
            if canvas: canvas.Document.Enabled = True
            if comp and hasattr(comp, "Attributes"): comp.Attributes.ExpireLayout()
            if canvas: canvas.Refresh()

    except Exception as e:
        # Catch outer errors (finding component, parsing GUID)
        result = {"status": "error", "result": "Outer error updating component: {}".format(e)}
        sc.sticky["last_error"] = result["result"]

    return result


# --- HTTP Server Logic ---

def socket_server_thread():
    """Background thread function to run the HTTP server."""
    host = '127.0.0.1'
    port = 9998
    server_socket = None

    try:
        server_socket = socket.socket(socket.AF_INET, socket.SOCK_STREAM)
        server_socket.setsockopt(socket.SOL_SOCKET, socket.SO_REUSEADDR, 1)
        server_socket.bind((host, port))
        server_socket.listen(5)
        sc.sticky["server_status"] = "Server listening on port {}".format(port)
        sc.sticky.pop("server_thread_error", None)

        while sc.sticky.get("run_server", True):
            conn = None
            addr = None
            try:
                # Use blocking accept initially, but with a timeout for the loop
                server_socket.settimeout(1.0)
                conn, addr = server_socket.accept()
                conn.settimeout(10.0) # Set timeout for operations on this connection
                sc.sticky["last_connection_addr"] = str(addr)

                # --- Read Request Headers ---
                headers_raw = ""
                while True:
                    try:
                        line = conn.recv(1024) # Read line by line (approx)
                        if not line: # Connection closed
                            headers_raw = "" # Reset if closed before headers end
                            break
                        headers_raw += line
                        if "\r\n\r\n" in headers_raw:
                            break
                        # Safety break for excessively long headers
                        if len(headers_raw) > 8192:
                             raise ValueError("Headers too large")
                    except socket.timeout:
                        raise socket.timeout("Timeout reading request headers")
                    except Exception as header_err:
                         raise ValueError("Error reading headers: {}".format(header_err))

                if not headers_raw or "\r\n\r\n" not in headers_raw:
                     # Connection closed or malformed before headers complete
                     if conn: conn.close()
                     continue # Go back to accept

                header_part, body_start = headers_raw.split("\r\n\r\n", 1)
                header_lines = header_part.split("\r\n")
                if not header_lines:
                    raise ValueError("Malformed headers received")

                # --- Parse Request Line and Headers ---
                request_line = header_lines[0]
                request_line_parts = request_line.split(' ')
                if len(request_line_parts) < 2:
                     raise ValueError("Malformed request line: {}".format(request_line))
                method = request_line_parts[0].upper()
                path = request_line_parts[1]

                headers = {}
                for line in header_lines[1:]:
                    header_parts = line.split(':', 1)
                    if len(header_parts) == 2:
                        headers[header_parts[0].strip().lower()] = header_parts[1].strip()

                # --- Read Request Body (if Content-Length specified) ---
                content_length = int(headers.get('content-length', 0))
                body = body_start # Include any part of the body received with headers
                
                # Read remaining body bytes based on Content-Length
                while len(body) < content_length:
                    bytes_to_read = min(4096, content_length - len(body))
                    try:
                        chunk = conn.recv(bytes_to_read)
                        if not chunk:
                            raise IOError("Connection closed unexpectedly while reading body")
                        body += chunk
                    except socket.timeout:
                        raise socket.timeout("Timeout reading request body")
                    except Exception as body_err:
                         raise ValueError("Error reading body: {}".format(body_err))
                
                sc.sticky["last_request_len"] = len(body) # Log actual body length read

                # --- Process Request ---
                response = handle_request(method, headers, body) # Pass parsed parts
                conn.sendall(response)

            except socket.timeout:
                 error_msg = "Socket timeout during connection handling with {}".format(addr if addr else 'unknown')
                 sc.sticky["server_thread_error"] = error_msg
                 # Try sending timeout response if possible
                 try:
                     timeout_response = "HTTP/1.1 408 Request Timeout\r\nContent-Length: 0\r\nConnection: close\r\n\r\n"
                     if conn: conn.sendall(timeout_response)
                 except: pass # Ignore errors sending timeout response
            except Exception as e:
                tb_str = traceback.format_exc()
                error_msg = "Error handling connection from {}: {}\n{}".format(addr if addr else 'unknown', e, tb_str)
                sc.sticky["server_thread_error"] = error_msg
                # Try sending internal server error response
                try:
                    error_response_body = json.dumps({"status": "error", "result": "Internal server error during connection handling."})
                    error_response = "HTTP/1.1 500 Internal Server Error\r\nContent-Type: application/json\r\nContent-Length: {}\r\nAccess-Control-Allow-Origin: *\r\nConnection: close\r\n\r\n{}".format(len(error_response_body), error_response_body)
                    if conn: conn.sendall(error_response)
                except Exception as send_err:
                    sc.sticky["server_thread_error"] = str(sc.sticky.get("server_thread_error", "")) + "\nAdditionally failed to send error response: {}".format(send_err)
            finally:
                if conn:
                    conn.close()

        # End of while loop (server stopping)
        sc.sticky["server_status"] = "Server stopped."

    except Exception as e:
        tb_str = traceback.format_exc()
        error_msg = "FATAL: Socket server thread failed: {}\n{}".format(e, tb_str)
        sc.sticky["server_thread_error"] = error_msg
        sc.sticky["server_status"] = "Server stopped due to error."
    finally:
        if server_socket:
            server_socket.close()
        current_status = sc.sticky.get("server_status", "")
        if "listening" in current_status: # Update only if it thought it was running
            sc.sticky["server_status"] = "Server stopped."


# --- HTTP Server Logic ---

def handle_request(method, headers, body):
    """
    Handles parsed HTTP request components (method, headers, body).
    Handles CORS preflight (OPTIONS) and processes POST commands.
    Returns the HTTP response string.
    """
    response_body = ""
    try:
        # --- Handle OPTIONS Preflight Request ---
        if method == "OPTIONS":
            # Send CORS preflight response
            cors_headers = {
                "Access-Control-Allow-Origin": "*", # Or specify origin for tighter security
                "Access-Control-Allow-Methods": "POST, OPTIONS",
                "Access-Control-Allow-Headers": "Content-Type",
                "Access-Control-Max-Age": "86400",
                "Content-Length": "0"
            }
            response_lines = ["HTTP/1.1 200 OK"]
            for key, value in cors_headers.items():
                response_lines.append("{}: {}".format(key, value))
            response_lines.append("Connection: close")
            response = "\r\n".join(response_lines) + "\r\n\r\n"
            sc.sticky["server_status"] = "Handled OPTIONS request"
            return response

        # --- Handle POST Request ---
        elif method == "POST":
            # Ensure content type is JSON if body exists
            content_type = headers.get('content-type', '').lower()
            if body and 'application/json' not in content_type:
                 raise ValueError("Invalid Content-Type for POST: '{}'. Expected 'application/json'.".format(content_type))

            if not body:
                 raise ValueError("No body found in POST request")

            json_body_str = body.strip('\x00').strip()
            if not json_body_str:
                raise ValueError("Empty body after stripping in POST request")

            try:
                command_data = json.loads(json_body_str)
            except ValueError as json_e:
                 raise ValueError("Invalid JSON received: {} - Body start: '{}...'".format(json_e, json_body_str[:100]))

            result = process_command(command_data) # process_command handles its own errors via sticky
            response_body = json.dumps(result, cls=GHEncoder) # Use GHEncoder
            status_line = "HTTP/1.1 200 OK"

            post_headers = {
                 "Content-Type": "application/json",
                 "Content-Length": str(len(response_body)),
                 "Access-Control-Allow-Origin": "*",
                 "Connection": "close"
             }
            response_lines = [status_line]
            for key, value in post_headers.items():
                response_lines.append("{}: {}".format(key, value))

            response = "\r\n".join(response_lines) + "\r\n\r\n" + response_body
            return response

        # --- Handle Other Methods ---
        else:
             raise ValueError("Unsupported HTTP method: {}".format(method))

    except Exception as e:
        tb_str = traceback.format_exc()
        error_msg = "Error processing request (Method: {}): {}\n{}".format(method, e, tb_str)
        sc.sticky["request_processing_error"] = error_msg # Log error

        # Prepare error response
        result = {"status": "error", "result": "Server error processing request. Check GH component output."}
        response_body = json.dumps(result)
        error_status = "HTTP/1.1 500 Internal Server Error" if not isinstance(e, ValueError) else "HTTP/1.1 400 Bad Request"
        error_headers = {
            "Content-Type": "application/json",
            "Content-Length": str(len(response_body)),
            "Access-Control-Allow-Origin": "*", # Allow CORS for error response too
            "Connection": "close"
        }
        response_lines = [error_status]
        for key, value in error_headers.items():
            response_lines.append("{}: {}".format(key, value))

        response = "\r\n".join(response_lines) + "\r\n\r\n" + response_body
        return response


# Modify process_command to avoid printing errors directly
def process_command(command_data):
    """Process a command and return the result dictionary. Uses sticky for errors."""
    command_type = command_data.get("type")
    # Clear previous processing errors before starting
    sc.sticky.pop("processing_error", None)
    sc.sticky.pop("last_error", None) # Clear specific update error too

    try:
        if command_type == "get_selected_script_component":
            # Execute on UI thread
            action = Action(lambda: sc.sticky.update({"__temp_result": get_selected_script_component_details()}))
            Rhino.RhinoApp.InvokeOnUiThread(action)
            # Check if the action itself failed to put anything in sticky (might happen if UI thread is blocked/crashes instantly)
            if "__temp_result" not in sc.sticky:
                 raise RuntimeError("UI thread action for get_selected_script_component did not complete or store result.")
            result = sc.sticky.pop("__temp_result", {"status": "error", "result": "UI thread execution failed for get_selected"})
            return result

        elif command_type == "update_script":
            instance_guid = command_data.get("instance_guid")
            code = command_data.get("code")
            description = command_data.get("description")
            param_definitions = command_data.get("param_definitions")

            if not instance_guid:
                 # Log error to sticky
                 sc.sticky["processing_error"] = "Missing 'instance_guid' for update_script."
                 return {"status": "error", "result": "Missing 'instance_guid'."}

            # Execute the update on the UI thread
            action = Action(lambda: sc.sticky.update({"__temp_result": update_script_component_on_ui_thread(instance_guid, code, description, param_definitions)}))
            Rhino.RhinoApp.InvokeOnUiThread(action)
            # Check if the action itself failed to put anything in sticky
            if "__temp_result" not in sc.sticky:
                 raise RuntimeError("UI thread action for update_script did not complete or store result.")
            result = sc.sticky.pop("__temp_result", {"status": "error", "result": "UI thread execution failed for update"})

            # Check for specific error logged during the update by update_script_component_on_ui_thread
            last_err = sc.sticky.get("last_error")
            if last_err and result.get("status") == "error":
                 result["result"] = "{}; Specific Error: {}".format(result.get("result", "Update error"), last_err)
            elif last_err:
                 result["warning"] = "Update success with issues: {}".format(last_err)

            return result

        else:
             # Log error to sticky
             sc.sticky["processing_error"] = "Unknown command type: {}".format(command_type)
             return {"status": "error", "result": "Unknown command type: {}".format(command_type)}

    # --- MODIFIED EXCEPTION HANDLING ---
    except Exception as e:
         tb_str = traceback.format_exc()
         # Log full traceback to sticky (for GH component bubble)
         error_msg_full = "Error in process_command ({}): {}\n{}".format(command_type, e, tb_str)
         sc.sticky["processing_error"] = error_msg_full

         # Create a more informative error message for the web app response
         error_detail_for_web = "Failed during '{}': {}".format(command_type, str(e))
         # Optionally add first line of traceback? Be cautious with length.
         # tb_lines = tb_str.splitlines()
         # if len(tb_lines) > 0: error_detail_for_web += " ({})".format(tb_lines[-1].strip())

         return {"status": "error", "result": error_detail_for_web} # Return specific error message
    # --- END MODIFIED EXCEPTION HANDLING ---


# --- Main Script Logic (runs in GHPython component) ---

# === Required Input: Add a boolean input named 'RunServer' to your component ===
# Default its value to True if you want the server to start automatically.
run_server_toggle = locals().get("RunServer", False) # Read the input, default to False if not connected

# === State Management using sc.sticky ===
server_was_intended_to_run = sc.sticky.get("server_is_intended_to_run", False)
server_thread_active = sc.sticky.get("socket_server_started", False) # Checks if thread object was created

# --- Start/Stop Logic ---
if run_server_toggle and not server_was_intended_to_run:
    # --- START SERVER ---
    # Check if a thread might still exist but wasn't flagged (e.g., after script reload)
    old_thread = sc.sticky.get("server_thread_obj")
    if old_thread and old_thread.isAlive():
         print("Warning: Previous server thread might still be active. Attempting to signal stop first.")
         sc.sticky["run_server"] = False # Signal old thread to stop
         time.sleep(1.2) # Give it a moment to potentially stop

    print("Toggle ON: Starting socket server thread...")
    try:
        # Ensure sticky is clean before start
        sc.sticky.pop("server_thread_error", None)
        sc.sticky.pop("request_processing_error", None)
        sc.sticky.pop("processing_error", None)
        sc.sticky.pop("last_error", None)
        sc.sticky.pop("server_status", None) # Clear old status

        sc.sticky["run_server"] = True # Flag for the thread loop
        thread = threading.Thread(target=socket_server_thread)
        thread.daemon = True
        thread.start()
        sc.sticky["socket_server_started"] = True # Mark thread object as created
        sc.sticky["server_thread_obj"] = thread # Store the thread object itself
        sc.sticky["server_is_intended_to_run"] = True # Mark desired state

        # Allow brief moment for server thread to update status
        time.sleep(0.1)
        print("Server thread initiated.")

    except Exception as start_err:
         print("ERROR starting server thread: {}".format(start_err))
         sc.sticky["socket_server_started"] = False
         sc.sticky["server_is_intended_to_run"] = False
         sc.sticky["server_thread_obj"] = None
         sc.sticky["server_status"] = "Failed to start"


elif not run_server_toggle and server_was_intended_to_run:
    # --- STOP SERVER ---
    print("Toggle OFF: Signaling server thread to stop...")
    sc.sticky["run_server"] = False # Signal thread to exit its loop
    sc.sticky["server_is_intended_to_run"] = False # Mark desired state
    # Note: Thread stops itself. We don't explicitly join() here to avoid blocking GH.
    # The thread status will update via sticky["server_status"] when it exits.
    # We keep 'socket_server_started' True until a new thread is started,
    # indicating a thread *was* running, even if stopping. Clear thread object ref.
    sc.sticky["server_thread_obj"] = None


# --- Status Reporting and Error Checking (Runs every time component updates) ---

# Check for errors logged by the background thread(s) and print from main thread
server_error = sc.sticky.pop("server_thread_error", None)
if server_error:
    ghenv.Component.AddRuntimeMessage(Grasshopper.Kernel.GH_RuntimeMessageLevel.Error, "Server Thread Error:\n" + str(server_error)[:500]) # Show in component bubble
    # print("! SERVER THREAD ERROR:\n{}".format(server_error)) # Optional: also print to Rhino console

req_proc_error = sc.sticky.pop("request_processing_error", None)
if req_proc_error:
    ghenv.Component.AddRuntimeMessage(Grasshopper.Kernel.GH_RuntimeMessageLevel.Warning, "Request Handling Error:\n" + str(req_proc_error)[:500])
    # print("! REQUEST PROCESSING ERROR:\n{}".format(req_proc_error))

cmd_proc_error = sc.sticky.pop("processing_error", None)
if cmd_proc_error:
    ghenv.Component.AddRuntimeMessage(Grasshopper.Kernel.GH_RuntimeMessageLevel.Warning, "Command Processing Error:\n" + str(cmd_proc_error)[:500])
    # print("! COMMAND PROCESSING ERROR:\n{}".format(cmd_proc_error))

# Get current status from sticky (updated by the server thread)
server_status_message = sc.sticky.get("server_status", "Server Off")

# Display current status
# Use component message bubble for primary status feedback
ghenv.Component.Message = server_status_message

# Optional: Set component nickname based on status
if "listening" in server_status_message.lower():
    ghenv.Component.NickName = COMPONENT_NICKNAME + " (Running)"
elif "error" in server_status_message.lower():
     ghenv.Component.NickName = COMPONENT_NICKNAME + " (Error)"
else:
    ghenv.Component.NickName = COMPONENT_NICKNAME + " (Stopped)"


# Optional: Output the status string to an output parameter named 'status'
# status = server_status_message

# --- Debug Output ---
# === Required Output: Add a text output named 'debug_output' to your component ===
debug_info_list = ["--- sc.sticky contents ({}) ---".format(time.strftime("%H:%M:%S"))]

# --- CORRECTED CHECK ---
# Check if the 'sc' module has the 'sticky' attribute and if it's dictionary-like
if hasattr(sc, "sticky"):
    try:
        # Create a sorted list of items for consistent order
        # Use items() for Python 2.7 compatibility with IronPython
        sticky_items = sc.sticky.items() # Get items first
        sorted_items = sorted(sticky_items)

        if not sorted_items:
            debug_info_list.append("(sticky is empty)")

        for key, value in sorted_items:
             # Avoid printing the raw thread object, show relevant info instead
             if key == "server_thread_obj" and isinstance(value, threading.Thread):
                 thread_state = "Alive" if value.isAlive() else "Not Alive"
                 value_str = "<Thread ID: {}, State: {}>".format(value.ident, thread_state)
             else:
                 # Convert value to string representation and truncate if too long
                 try:
                     value_str = repr(value) # Use repr for clearer type info
                 except Exception as repr_err:
                      value_str = "[Error getting repr: {}]".format(repr_err)

                 if len(value_str) > 200: # Limit length for readability
                     value_str = value_str[:200] + "..."

             debug_info_list.append(u"{}: {}".format(key, value_str)) # Use unicode literals

    except AttributeError:
         # Catch if sc.sticky is not dict-like (e.g., None) after hasattr check passes
         debug_info_list.append("(sc.sticky exists but is not dictionary-like)")
    except Exception as debug_err:
        debug_info_list.append("! Error reading sticky: {}".format(debug_err))
else:
    debug_info_list.append("(Attribute 'sticky' not found on 'sc')")
# --- END CORRECTED CHECK ---

# Assign the formatted string list joined by newlines to the debug_output variable.
# Grasshopper will automatically pass this to the output parameter named 'debug_output'.
debug_output = "\n".join(debug_info_list)
# ---------- end vibecode_gh_server_running ----------

# ==== cluster Cluster
geometry = ClusterInput()
count = ClusterInput()
curves_b = ClusterInput()
data = ClusterInput()
populate_geometry = PopulateGeometry(Geometry=geometry, Count=count, Seed=1)
voronoi = Voronoi(Points=populate_geometry, Radius=Slider(188, range=1..1100), BruteForceOverride=False)
region_intersection = RegionIntersection(CurvesA=voronoi, CurvesB=curves_b)
surface = Surface(region_intersection)
populate_geometry_2 = PopulateGeometry(Geometry=graft(surface), Count=Slider(16, range=1..100), Seed=1)
data_2 = Data(data)
project = Project(Geometry=data_2, Plane=PlaneXY(0, 0, 0))  # -> Geometry, Transform
geometry_2 = ClusterOutput(project.Geometry)
voronoi_2 = Voronoi(Points=populate_geometry_2, Radius=Slider(133, range=1..1100), BruteForceOverride=False)  # -> simplify(Cells)
offset_curve = OffsetCurve(Curve=region_intersection, Distance=Slider(-10, range=-100..100), Corners=1)
distance = Distance(PointA=simplify(flatten(populate_geometry_2)), PointB=simplify(graft(project.Geometry)))  # -> simplify(Distance)
deconstruct = Deconstruct(Point=data_2)  # -> XComponent, YComponent, ZComponent
list_length = ListLength(List=populate_geometry_2)
region_intersection_2 = RegionIntersection(CurvesA=simplify(voronoi_2), CurvesB=simplify(graft(offset_curve)))
area = Area(Geometry=region_intersection_2)  # -> Area, Centroid
flip_matrix = FlipMatrix(Data=distance)
square_root = SquareRoot(Value=flip_matrix)
smaller_than = SmallerThan(FirstNumber=Slider(1201, range=0..10000), SecondNumber=area.Area)  # -> SmallerThan, OrEqualTo
one_over_x = OneOverX(Value=flip_matrix)
remap_numbers = RemapNumbers(Value=square_root, Source="0 To 30", Target="1 To 0")  # -> Mapped, Clipped
cull_pattern = CullPattern(List=region_intersection_2, CullPattern=smaller_than.SmallerThan)
list_length_2 = ListLength(List=cull_pattern)
multiplication = Multiplication(A=deconstruct.ZComponent, B=remap_numbers.Mapped)
offset_curve_2 = OffsetCurve(Curve=simplify(cull_pattern), Distance=Slider(-9, range=-100..100), Corners=1)
weighted_average = WeightedAverage(Input=multiplication, Weights=one_over_x)
random = Random(Range=Slider(5, range=5..10), Number=list_length_2, Seed=2)
list_length_3 = ListLength(List=data_2)
trim_tree = TrimTree(Tree=offset_curve_2, Depth=1)
division = Division(A=multiplication, B=list_length_3)
mass_addition = MassAddition(Input=division)  # -> Result, PartialResults
partition_list = PartitionList(List=flatten(weighted_average), Size=simplify(flatten(list_length)))
addition = Addition(A=simplify(random), B=simplify(partition_list))
surface_2 = Surface(trim_tree)
unit_z = UnitZ(Factor=addition)
extrude = Extrude(Base=surface_2, Direction=simplify(unit_z))
extrusion = ClusterOutput(extrude)
